# Dynamo graph Create Or Update Placeholder Sheets From Excel.dyn (Dynamo 1.2.1.3083)

# group: Create Or Update Placeholder Sheets from Excel
# note: SUPPORT
# Dynamo version: 1.2.1
# Revit version: 2016, 2017
# Required Packages: NONE
# Last Update: 2016.12.21
# Author: Josh Moore
# note: INSTRUCTIONS
# The script will read an excel file and update existing or create new placeholder sheets in the active Revit model.  Particularly useful for creating consultant sheet data for Sheet Index.
# Step 1) Ensure the excel file is set up properly.  It should have 4 columns:  Sheet Number (col1), Sheet Name (col2), Drawing List Grouping (col3), and Issue Date (col4).
# Step 2) Ensure that the parameter names you are using match in Revit and the Dynamo Script.  Column headings in the Excel file don't matter and will be ignored.
# Step 3) For the excel file path, Shift+Right click on the excel file and select "copy as path".  Paste into string node in dynamo in the user interace section.  Be sure to remove the quotes at the front and back.
# note: NOTES / ISSUES

# group: User Inputs
full_path_including_name_to = StringInput("C:\Users\moorej\Documents\BSWI Sheet Index - Tower MASTER.xlsx")  # "Full Path (including name) to excel file"
sheet_issue_date_parameter_name = StringInput("SHT_DisciplineSortOrder_PWProj")
issue_date_parameter_to_update = StringInput("SHT_IssueDate1_PWProj")

# group: Getting the Excel File data and remove the headers
fromPath = FileObject(full_path_including_name_to)  # "File.FromPath"
code_block = CodeBlock { "Sheet1"; }
code_block_2 = CodeBlock { true; }
readFromFile = Excel.ReadFromFile(file=fromPath, sheetName=code_block, readAsStrings=code_block_2)
restOfItems = List.RestOfItems(readFromFile)

# group: Getting all existing sheets and determining if there are matching sheets already in the model
transpose = List.Transpose(restOfItems)
code_block_3 = CodeBlock { 0; }
getItemAtIndex = List.GetItemAtIndex(list=transpose, index=code_block_3)
string_from_object = FromObject(getItemAtIndex)
categories = Categories("Sheets")
all_elements_of_category = ElementsOfCategory(categories)
sheetNumber = Sheet.SheetNumber(all_elements_of_category)
string_from_object_2 = FromObject(sheetNumber)
eq = string_from_object == string_from_object_2  # lacing=CrossProduct
anyTrue = Custom[List.AnyTrue](seq=eq)  # Returns true if any item in a list of booleans is true.

# group: Filtering down the excel data to sheets that don't already exist, and getting that data in individual data streams
filterByBoolMask = List.FilterByBoolMask(list=restOfItems, mask=anyTrue)
transpose_2 = List.Transpose(filterByBoolMask.out)
code_block_4 = CodeBlock { 0; }
getItemAtIndex_2 = List.GetItemAtIndex(list=transpose_2, index=code_block_4)
string_from_object_3 = FromObject(getItemAtIndex_2)
code_block_5 = CodeBlock { 1; }
getItemAtIndex_3 = List.GetItemAtIndex(list=transpose_2, index=code_block_5)
string_from_object_4 = FromObject(getItemAtIndex_3)
code_block_6 = CodeBlock { 2; }
getItemAtIndex_4 = List.GetItemAtIndex(list=transpose_2, index=code_block_6)
code_block_7 = CodeBlock { 3; }
getItemAtIndex_5 = List.GetItemAtIndex(list=transpose_2, index=code_block_7)

# group: Creating the new Placeholder Sheets and adding the Discipline and Issue Date information
createPlaceholder = Views.Sheet.CreatePlaceholder(string_from_object_3, string_from_object_4)
flatten = Flatten(createPlaceholder)
setParameterByName = Element.SetParameterByName(element=flatten, parameterName=sheet_issue_date_parameter_name, value=getItemAtIndex_4)
setParameterByName_2 = Element.SetParameterByName(element=flatten, parameterName=issue_date_parameter_to_update, value=getItemAtIndex_5)

# group: Filtering down the list of sheets
code_block_8 = CodeBlock { true; }
allIndicesOf = List.AllIndicesOf(list=eq@L2, item=code_block_8)
flatten_2 = Flatten(allIndicesOf)
getItemAtIndex_6 = List.GetItemAtIndex(list=all_elements_of_category, index=flatten_2)

# group: Filtering down the Excel data and getting just the sheet issue date column
filterByBoolMask_2 = List.FilterByBoolMask(list=restOfItems, mask=anyTrue)
transpose_3 = List.Transpose(filterByBoolMask_2.in)
code_block_9 = CodeBlock { 3; }
getItemAtIndex_7 = List.GetItemAtIndex(list=transpose_3, index=code_block_9)

# group: Setting the issue date for the existing sheets based on the excel file data
setParameterByName_3 = Element.SetParameterByName(element=getItemAtIndex_6, parameterName=issue_date_parameter_to_update, value=getItemAtIndex_7)
